# Grasshopper definition Nicol graph.gh (Grasshopper 1.0.7)
# plug-ins: MetaHopper, UiPlus, TT Toolbox

ism_ob_2007_2021_epw = ValueList({"A North - Haifa": "isr_z_haifa.ap_.401550_tmyx.2007-2021", "A Center - Sde Dov": "isr_ta_tel.aviv-sde-dov_.ap_.401762_tmyx.2007-2021", "B Center - Bet Dagan": "isr_ta_tel.aviv-bet-dagan_.401790_tmyx.2007-2021", "B North - Mahanaim": "isr_z_mahanaim-pina.ap_.401761_tmyx.2007-2021", "B South - BeerSheva": "isr_d_beer.sheva_.401900_tmyx.2007-2021", "C North - Zfat": "isr_z_zefat-har.kenaan.ms_.401530_tmyx.2007-2021", "C Center - Jerusalem  - Center": "isr_jm_jerusalem-center_.401830_tmyx.2007-2021", "D - Eilat": "isr_d_eilat-hozman.ap_.401990_tmyx.2007-2021"}, selected="A North - Haifa")
# https://www.new-learn.info/packages/clear/thermal/people/adaptive/adapt_standards.html
# http://climate.onebuilding.org/WMO_Region_6_Europe/GBR_United_Kingdom/ENG_England/GBR_ENG_RAF.Benson.036580_TMYx.zip
python = GhPythonScript(epw_folder="C:\IsraelWeatheFiles_2007-2021_WindStandarized\", weather_station=ism_ob_2007_2021_epw)  # -> epw_file, stat_file, ddy_file
# ---------- python: Python ----------
try:
    from ladybug_rhino.grasshopper import all_required_inputs, give_warning
except ImportError as e:
    raise ImportError('\nFailed to import ladybug_rhino:\n\t{}'.format(e))

import os

if all_required_inputs(ghenv.Component):
    # default file names
    print _weather_station
    if   _weather_station == 'isr_ta_tel.aviv-sde-dov_.ap_.401762_tmyx.2007-2021' or \
         _weather_station == 'isr_ta_tel.aviv-bet-dagan_.401790_tmyx.2007-2021'   or \
         _weather_station == 'isr_d_beer.sheva_.401900_tmyx.2007-2021'            or \
         _weather_station == 'isr_z_zefat-har.kenaan.ms_.401530_tmyx.2007-2021'   or \
         _weather_station == 'isr_jm_jerusalem-center_.401830_tmyx.2007-2021'     or \
         _weather_station == 'isr_d_eilat-hozman.ap_.401990_tmyx.2007-2021':
             _weather_station_n = _weather_station + " - Wind Standardized"
    else:
             _weather_station_n = _weather_station
        
    epw  = os.path.join(_epw_folder, _weather_station_n + '.epw')
    ddy  = os.path.join(_epw_folder, _weather_station_n + '.ddy')
    stat = os.path.join(_epw_folder, _weather_station   + '.stat')
    
    if not os.path.isfile(epw) :
        epw_file  = None
        msg = 'No EPW weather file in directory.'
        print (msg)
        give_warning(ghenv.Component, msg)
    else:
        epw_file  = epw
    if not os.path.isfile(ddy) :
        ddy_file  = None
        msg = 'No DDY weather file in directory.'
        print (msg)
        give_warning(ghenv.Component, msg)
    else:
        ddy_file  = ddy
    if not os.path.isfile(stat) :
        stat_file  = None
        msg = 'No STAT weather file in directory.'
        print (msg)
        give_warning(ghenv.Component, msg)
    else:
        stat_file  = stat
# ---------- end python ----------

importepw = LBImportEPW(epw_file=python.epw_file)  # -> location, dry_bulb_temperature, dew_point_temperature, relative_humidity, wind_speed, wind_direction, direct_normal_rad, diffuse_horizontal_rad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; plug-in component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
xdata = LBDeconstructData(data=importepw.dry_bulb_temperature)  # -> header, values; plug-in component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
panel = Panel("""744
672
744
720
744
720
744
744
720
744
720
744""")

ism_ob_2007_2021_epw_2 = ValueList({"A North - Haifa": "isr_z_haifa.ap_.401550_tmyx.2007-2021", "A Center - Sde Dov": "isr_ta_tel.aviv-sde-dov_.ap_.401762_tmyx.2007-2021", "B Center - Bet Dagan": "isr_ta_tel.aviv-bet-dagan_.401790_tmyx.2007-2021", "B North - Mahanaim": "isr_z_mahanaim-pina.ap_.401761_tmyx.2007-2021", "B South - BeerSheva": "isr_d_beer.sheva_.401900_tmyx.2007-2021", "C North - Zfat": "isr_z_zefat-har.kenaan.ms_.401530_tmyx.2007-2021", "C Center - Jerusalem  - Center": "isr_jm_jerusalem-center_.401830_tmyx.2007-2021", "D - Eilat": "isr_d_eilat-hozman.ap_.401990_tmyx.2007-2021"}, selected="D - Eilat")
python_2 = GhPythonScript(epw_folder="C:\IsraelWeatheFiles_2007-2021_WindStandarized\", weather_station=ism_ob_2007_2021_epw_2)  # -> epw_file, stat_file, ddy_file; same code as python

partition = PartitionList(List=xdata.values, Size=panel)  # -> simplify(Chunks)
partition_2 = PartitionList(List=partition, Size="24")  # -> simplify(Chunks)
bnd = Bounds(Numbers=partition_2)
number_slider = Slider(1, range=1..12)
number_slider_2 = Slider(21, range=1..31)
dedomain = DeconstructDomain(Domain=bnd)  # -> Start, End
panel_2 = Panel("""31
28
31
30
31
30
31
31
30
31
30
31""")
data = Data(flatten(dedomain.Start))
data_2 = Data(flatten(dedomain.End))
analysisperiod = LBAnalysisPeriod(start_month=number_slider, start_day=number_slider_2, start_hour=0, end_month=number_slider, end_day=number_slider_2)  # -> period, hoys, dates; plug-in component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

# ---- group: Weather data
list = ValueList({"BeerSheva": "https://www.energyplus.net/weather-download/europe_wmo_region_6/ISR//ISR_Beer.Sheva.401900_MSI/all", "Tel Aviv - Bet Dagan": "https://www.energyplus.net/weather-download/europe_wmo_region_6/ISR//ISR_Tel.Aviv-Bet.Dagan.401790_MSI/all", "Tel Aviv - Ben Gurion": "http://climate.onebuilding.org/WMO_Region_6_Europe/ISR_Israel/TA_Tel-Aviv/ISR_TA_Tel.Aviv-Ben.Gurion.Intl.AP.401790_IMS.zip", "Eilat": "https://www.energyplus.net/weather-download/europe_wmo_region_6/ISR//ISR_Eilat.401990_MSI/all", "Jerusalem": "https://www.energyplus.net/weather-download/europe_wmo_region_6/ISR//ISR_Jerusalem.401840_IWEC/all", "Jerusalem - Atarot": "https://www.energyplus.net/weather-download/europe_wmo_region_6/ISR//ISR_Jerusalem-Atarot.AP.401840_MSI/all", "None": "", "Ashalim": "C:\IsraelWeatherFiles\ISR_Ashalim_MN6.epw", "Haifa_WhiteBoxTech": "C:\IsraelWeatherFiles\ISR_HAIFA_401550_IW2.EPW", "Haifa_Segoe": "C:\IsraelWeatherFiles\ISR_HaifaSego.epw", "Haifa_BatGalim": "C:\IsraelWeatherFiles\HaifaBatGalim-SPtMasterTable_552848_19790101_20110101_TMY3.epw", "Haifa_Technion": "C:\IsraelWeatherFiles\HaifaTechnion_SPtMasterTable_551698_19790101_20110101_TMY3.epw", "Natanya_Dura": "C:\IsraelWeatherFiles\Natanya-SPtMasterTable_550544_19790101_20110101_TMY3.epw"}, selected="Jerusalem")

# ----
panel_3 = Panel("http://climate.onebuilding.org/WMO_Region_6_Europe/GBR_United_Kingdom/ENG_England/GBR_ENG_RAF.Benson.036580_TMYx.zip")
# daily minimum (To min)
partition_3 = PartitionList(List=data, Size=panel_2)  # -> simplify(Chunks)
# daily maximum (To max)
partition_4 = PartitionList(List=data_2, Size=panel_2)  # -> simplify(Chunks)
avr = Average(Input=partition_3)  # -> flatten(ArithmeticMean)
avr_2 = Average(Input=partition_4)  # -> flatten(ArithmeticMean)
downloadepw = LBDownloadWeather(weather_URL=panel_3)  # -> epw_file, stat_file, ddy_file; plug-in component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
# mean outdoor temperature (Tom)
merge = Merge(Data1=graft(avr), Data2=graft(avr_2))
importepw_2 = LBImportEPW(epw_file=python_2.epw_file)  # -> location, dry_bulb_temperature, dew_point_temperature, relative_humidity, wind_speed, wind_direction, direct_normal_rad, diffuse_horizontal_rad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; plug-in component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
sunpath = LBSunPath(location=importepw_2.location, hoys=analysisperiod.hoys, scale=1)  # -> report, vectors, altitudes, azimuths, hoys, sun_pts, analemma, daily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; plug-in component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
avr_3 = Average(Input=merge)  # -> flatten(ArithmeticMean)
xdata_2 = LBDeconstructData(data=[importepw_2.dry_bulb_temperature, importepw_2.relative_humidity])  # -> header, simplify(values); plug-in component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
# Comfort temperature
expression = Expression(Tom=avr_3, Expression="0.54 * Tom + 12.9")

# ----
# https://nicolgraph.com/#config
# Nicol Graph
number_slider_3 = Slider(150, range=0..1000)
# https://www.new-learn.info/packages/clear/thermal/people/adaptive/adapt_standards.html
panel_4 = Panel("Nicol Graph")
setscribble = SetScribbleProperties(
    Scribble="Grasshopper.Kernel.Types.GH_ObjectWrapper",
    ScribbleText=panel_4,
    ScribbleSize=number_slider_3,
    ScribbleFont="Montserrat")

xdata_3 = LBDeconstructData(data=importepw_2.dry_bulb_temperature)  # -> header, values; plug-in component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
panel_5 = Panel("Tcomf = 0.54 Tom + 12.9")
bang = ExplodeTree(Data=xdata_2.values)  # -> Branch0, Branch1
panel_6 = Panel("19")
eval = Evaluate(F="0.54 * Tom + 12.9", Tom=avr_3)
python_3 = GhPythonScript(location=importepw_2.location, dry_bulb_temperature=bang.Branch0, relative_humidity=bang.Branch1)  # -> out, ToMin, ToMax, ToM, ComfTemp, sunshineHrs, RHM; inputs dry_bulb_temperature: list, relative_humidity: list
# ---------- python_3: Python ----------
## Source:
## https://www.new-learn.info/packages/clear/thermal/people/adaptive/adapt_standards.html

from collections import Counter
from statistics import mean
try:
    from ladybug.sunpath import Sunpath
    from ladybug.datacollection import HourlyContinuousCollection
    from ladybug.dt import Date
    from ladybug.dt import DateTime
except ImportError as e:
    raise ImportError('\nFailed to import ladybug:\n\t{}'.format(e))

allListDBT  = []
allListRH  = []
daysList = []
#totDays  = 0
counter  = 0
for mth in range(12):
    if mth == 1:
        days = 28
    elif mth == 0 or mth == 2 or mth == 4 or mth == 6 or mth == 7 or mth == 9 or mth == 11:
        days = 31
    else:
        days = 30
    ##print 'Month hours ' , mth, (days * 24), totDays, 'Subtotal hours ', (totDays * 24 + days * 24)
    daysList.append(days)
    #totDays += days
    for day in range(days):
        list24HrsDBT = []
        list24HrsRH  = []
        for hr in range(0, 24):
            list24HrsDBT.append(_dry_bulb_temperature[counter])                          # Create list of 24 hrs data
            list24HrsRH.append( _relative_humidity[counter])                          # Create list of 24 hrs data
            counter += 1
        allListDBT.append(list24HrsDBT)
        allListRH.append(list24HrsRH)
##print len(allListDBT), len(daysList)
allMinDBT = []
allMaxDBT = []
allMinRH  = []
allMaxRH  = []
for m in range(len(allListDBT)):
    allMinDBT.append(min(allListDBT[m]))
    allMaxDBT.append(max(allListDBT[m]))
aveMinDBT = mean(allMinDBT)
aveMaxDBT = mean(allMaxDBT)
for m in range(len(allListDBT)):
    allMinRH.append(min(allListRH[m]))
    allMaxRH.append(max(allListRH[m]))

dayL     = 0
ToMin    = []
ToMax    = []
ToM      = []                                                            # mean outdoor temperature (ToM)
ComfTemp = []                                                            # Comfort temperature
RHM      = []                                                            # mean outdoor temperature (ToM)
for n in range(len(daysList)):
    ToMin.append( round( mean(allMinDBT[dayL:dayL + daysList[n]]), 1 ) )    # Daily Minimum
    ToMax.append( round( mean(allMaxDBT[dayL:dayL + daysList[n]]), 1 ) )    # Daily Maximum
    ToM.append( round( (mean(allMinDBT[dayL:dayL + daysList[n]]) + mean(allMaxDBT[dayL:dayL + daysList[n]]) ) /2, 1 ) )
    
    RHM.append( round( (mean(allMinRH[dayL:dayL + daysList[n]]) + mean(allMaxRH[dayL:dayL + daysList[n]]) ) /2, 1 ) )
    
    ##tmp = 0.54 * ToM[n] + 12.9
    tmp = 13.8 + 0.53 * ToM[n]
    #tmp = 13.8 + 0.53(±0.02) * ToM[n]
    
    if lowComfTemp != None:
        if tmp < lowComfTemp:
            tmp = lowComfTemp
    
    ComfTemp.append( round(tmp, 1) )
    dayL += daysList[n]

# Calculate the average number of sunshine hours per month
# initialize sunpath based on location
sp = Sunpath.from_location(_location, 0, None)

month, dayH, hoys = [], [], []
for hoy in range(8760):
    sun = sp.calculate_sun_from_hoy(hoy, False)
    if sun.is_during_day:
        hoys.append(sun.datetime.hoy)

for hoy in hoys:
    datetime = DateTime.from_hoy(hoy)
    month.append(datetime.month)
    dayH.append(datetime.day)

sunshineHrs = []
sunHrs = Counter(month)
for mt in range(1, 13):
    sunshineHrs.append( round( sunHrs[mt] / daysList[mt - 1], 1 ) )
# ---------- end python_3 ----------
python_4 = GhPythonScript(location=importepw_2.location, dry_bulb_temperature=bang.Branch0, relative_humidity=bang.Branch1)  # -> out, ToMin, ToMax, ToM, ComfTemp, sunshineHrs, RHM; inputs dry_bulb_temperature: list, relative_humidity: list; same code as python_3
python_5 = GhPythonScript(Tom=expression)  # -> out, TomN; inputs Tom: list
# ---------- python_5: Python ----------
TomN = []
for i in Tom:
    if i < 19:
        i = 19
    else:
        pass
    TomN.append(i)
# ---------- end python_5 ----------
entwine = Entwine(Branch00=avr, Branch01=avr_2, Branch02=avr_3, Branch03=python_5.TomN, FlattenInputs=True)
entwine_2 = Entwine(Branch00=python_3.ToMin, Branch01=python_3.ToMax, Branch02=python_3.ToM, Branch03=python_3.ComfTemp, FlattenInputs=True)  # -> simplify(Result)

# ----
# Nicol Graph
# Orig
python_6 = GhPythonScript(rawData=xdata_3.values, lowComfTemp="19")  # -> out, ToMin, ToMax, ToM, ComfTemp; inputs rawData: list
# ---------- python_6: Python ----------
## Source:
## https://www.new-learn.info/packages/clear/thermal/people/adaptive/adapt_standards.html

from statistics import mean

allList  = []
daysList = []
#totDays  = 0
counter  = 0
for mth in range(12):
    if mth == 1:
        days = 28
    elif mth == 0 or mth == 2 or mth == 4 or mth == 6 or mth == 7 or mth == 9 or mth == 11:
        days = 31
    else:
        days = 30
    ##print 'Month hours ' , mth, (days * 24), totDays, 'Subtotal hours ', (totDays * 24 + days * 24)
    daysList.append(days)
    #totDays += days
    for day in range(days):
        list24Hrs = []
        for hr in range(0, 24):
            list24Hrs.append(rawData[counter])                # Create list of 24 hrs data
            counter += 1
        allList.append(list24Hrs)

allMin = []
allMax = []
for m in range(len(allList)):
    allMin.append(min(allList[m]))
    allMax.append(max(allList[m]))
aveMin = mean(allMin)
aveMax = mean(allMax)

dayL     = 0
ToMin    = []
ToMax    = []
ToM      = []                                                 # mean outdoor temperature (ToM)
ComfTemp = []                                                 # Comfort temperature
for n in range(len(daysList)):
    
    ToMin.append( round( mean(allMin[dayL:dayL + daysList[n]]), 1 ) )    # Daily Minimum
    ToMax.append( round( mean(allMax[dayL:dayL + daysList[n]]), 1 ) )    # Daily Maximum
    ToM.append( round( (mean(allMin[dayL:dayL + daysList[n]]) + mean(allMax[dayL:dayL + daysList[n]]) ) /2, 1 ) )
    
    #ToMin.append( mean(allMin[dayL:dayL + daysList[n]]) )     # Daily Minimum
    #ToMax.append( mean(allMax[dayL:dayL + daysList[n]]) )     # Daily Maximum
    #ToM.append( ( mean(allMin[dayL:dayL + daysList[n]]) + mean(allMax[dayL:dayL + daysList[n]]) ) /2 )
    tmp = 0.54 * ToM[n] + 12.9
    if tmp < lowComfTemp:
        tmp = lowComfTemp
    
    ComfTemp.append( round(tmp, 1) )
    #ComfTemp.append( tmp )
    dayL += daysList[n]
# ---------- end python_6 ----------
entwine_3 = Entwine(Branch00=python_6.ToMin, Branch01=python_6.ToMax, Branch02=python_6.ToM, Branch03=python_6.ComfTemp, FlattenInputs=True)  # -> simplify(Result)
graph = QuickGraph(entwine_2, SortOrder=0)

# ----
# Headers
panel_7 = Panel("ToMax")
entwine_4 = Entwine(Branch00="ToMin", Branch01=panel_7, Branch02="ToM", Branch03="ComfTemp", FlattenInputs=True)  # -> simplify(Result)
constrtype = LBConstructDataType(name=entwine_4, unit="Temperature")  # -> type; plug-in component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
entwine_5 = Entwine(Branch00=":ToMin", Branch01=":ToMax", Branch02=":ToM", Branch03=":ComfTemp", FlattenInputs=True)  # -> simplify(Result)
constrheader = LBConstructHeader(data_type=constrtype, unit="Temperature", metadata=entwine_5)  # -> header; plug-in component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
data_3 = LBConstructData(header=constrheader, values=entwine_2, interval="monthly")  # -> data; plug-in component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
monthlychart = LBMonthlyChart(data=flatten(data_3), global_title="Nicol Graph", y_axis_title="Temperature")  # -> report, data_mesh, data_lines, col_lines, legend, borders, labels, y_title, title; plug-in component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

entwine_6 = Entwine(Branch00=python_4.ToMin, Branch01=python_4.ToMax, Branch02=python_4.ToM, Branch03=python_4.ComfTemp, FlattenInputs=True)  # -> simplify(Result)
graph_2 = QuickGraph(entwine, SortOrder=0)
graph_3 = QuickGraph(entwine_6, SortOrder=0)
sunshinehrs = Panel(python_3.sunshineHrs)
relhumid = Panel(python_3.RHM)
tomin = Panel(python_4.ToMin)
tomax = Panel(python_4.ToMax)
comftemp = Panel(python_4.ComfTemp)
tom = Panel(python_4.ToM)
list_2 = ValueList({"Text": 0, "Integer": 1, "Number": 2, "Point": 3, "Domain": 4}, selected="Number")
entwine_7 = Entwine(Branch00="ToMin", Branch01="ToMax", Branch02="ToM", Branch03="ComfTemp", FlattenInputs=True)  # -> simplify(Result)

# ----
# Auto
data_set = UIDataSet(Label=entwine_7, Data=entwine_3, Type=list_2)  # -> flatten(DataSeries)
line_chart = UiLineChart(Horizontal=False, Smoothness=0)
window = UIWindow(Elements=line_chart, Title="Nicol Graph", Owner=1, Launch=Button())
line_chart_2 = UiLineChart(Element=line_chart, DataSeries=data_set, Horizontal=Toggle(True), Smoothness=Slider(0, range=0..1))

data_set_2 = UIDataSet(Label=entwine_7, Data=entwine_3, Type=list_2)  # -> flatten(DataSeries)
line_chart_3 = UiLineChart(Horizontal=False, Smoothness=0)
window_2 = UIWindow(Elements=line_chart_3, Title="Nicol Graph", Owner=1, Launch=Button())
line_chart_4 = UiLineChart(Element=line_chart_3, DataSeries=data_set_2, Horizontal=Toggle(True), Smoothness=Slider(0.5, range=0..1))
graphics = UiSetGraphics(
    Element=line_chart_4,
    PrimaryColor=ColourSwatch(SwatchColor=RGB(0, 0, 0)),
    AccentColor=ColourSwatch(SwatchColor=RGB(176, 176, 176)),
    StrokeColor=ColourSwatch(SwatchColor=RGBA(0, 187, 255, 61)))
list_3 = ValueList({"None": 0, "Values": 1, "ValuesX": 2, "ValuesY": 3, "SeriesX": 4, "SeriesY": 5}, selected="Values")
list_4 = ValueList({"None": 0, "Top": 1, "Botton": 2, "Left": 3, "Right": 4}, selected="Botton")
modify_chart = UiModifyChart(
    ChartElement=graphics,
    XAxisTitle="Month",
    YAxisTitle="Temperature [oC]",
    LegendLocation=list_4,
    Format=list_3,
    ShowSeries=Toggle(False))

month = Panel("""Jan
Feb
Mar
Apr
May
Jun
Jul
Aug
Sep
Oct
Nov
Dec""")

# ----
# Labels
data_set_3 = UIDataSet(Label=entwine_7, Data=entwine_3, Type=list_2)  # -> flatten(DataSeries)
list_5 = ValueList({"None": 0, "Circle": 1, "Square": 2, "Diamond": 3}, selected="Diamond")
merge_2 = Merge(
    Data1=ColourSwatch(SwatchColor=RGB(255, 0, 0)),
    Data2=ColourSwatch(SwatchColor=RGB(0, 68, 255)),
    Data3=ColourSwatch(SwatchColor=RGB(255, 149, 0)),
    Data4=ColourSwatch(SwatchColor=RGB(0, 201, 30)))
ds_graphics = UiDataSetGraphics(
    DataSeries=data_set_3,
    PrimaryColor=merge_2,
    AccentColor=ColourSwatch(SwatchColor=RGBA(166, 185, 255, 10)),
    Weight=Slider(2, range=0..10),
    Marker=list_5)
panel_8 = Panel("A")
ds_labels = UiDatasetLabels(DataSeries=ds_graphics, Color=ColourSwatch(SwatchColor=RGBA(255, 255, 255, 133)))
line_chart_5 = UiLineChart(Horizontal=False, Smoothness=0)
data_4 = Data(flatten(ds_labels))
window_3 = UIWindow(Elements=line_chart_5, Title="Nicol Graph", Owner=1, Launch=Button())
line_chart_6 = UiLineChart(Element=line_chart_5, DataSeries=data_4, Horizontal=Toggle(True), Smoothness=Slider(0, range=0..1))
graphics_2 = UiSetGraphics(
    Element=line_chart_6,
    PrimaryColor=ColourSwatch(SwatchColor=RGB(2, 2, 31)),
    AccentColor=ColourSwatch(SwatchColor=RGB(176, 176, 176)),
    StrokeColor=ColourSwatch(SwatchColor=RGBA(0, 187, 255, 61)))
list_6 = ValueList({"None": 0, "Values": 1, "ValuesX": 2, "ValuesY": 3, "SeriesX": 4, "SeriesY": 5}, selected="Values")
list_7 = ValueList({"None": 0, "Top": 1, "Botton": 2, "Left": 3, "Right": 4}, selected="Botton")
modify_chart_2 = UiModifyChart(
    ChartElement=graphics_2,
    XAxisTitle="Axis X",
    YAxisTitle="Axis Y",
    LegendLocation=list_7,
    Format=list_6,
    ShowSeries=Toggle(False))

# ----
# Write to Excel
xheader = LBDeconstructHeader(header=xdata_3.header)  # -> data_type, unit, a_period, metadata; plug-in component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
item = ListItem(List=xheader.metadata, Index=0, Wrap=True)
fragment = TextFragment(Text=item, Start="6")
panel_9 = Panel("C:\WorkingFolder\Courses\Rhino-Grasshopper-Diva\LadybugTools_2020\honeybee-grasshopper.0.0.06\EXAMPLES\ladybug-grasshopper-master")
button = Button()
entwine_8 = Entwine(
    Branch00=month,
    Branch01=python_3.ToMin,
    Branch02=python_3.ToMax,
    Branch03=python_3.ToM,
    Branch04=python_3.ComfTemp,
    Branch05=python_3.sunshineHrs,
    Branch06=python_3.RHM,
    FlattenInputs=True)  # -> simplify(Result)
results = Data(entwine_8)
int = Integer(1)

concat = Concatenate(FragmentA="NicolGraph_", FragmentB=fragment)
concat_2 = Concatenate(FragmentA=panel_9, FragmentB="\")
panel_10 = Panel(button)
concat_3 = Concatenate(A=concat_2, B="NicolGraph_", D=fragment, C=".xlsx")

entwine_9 = Entwine(
    Branch00="Month",
    Branch01="ToMin",
    Branch02="ToMax",
    Branch03="ToM",
    Branch04="ComfTemp",
    Branch05="SunshineHrs",
    Branch06="RHM",
    Branch07=concat,
    FlattenInputs=True)  # -> simplify(flatten(Result))
column_name = Data(entwine_9)
panel_11 = Panel(concat_3)
wo = WriteOptions(
    FilePath=concat_3,
    ClearDataOverwrite=Toggle(True),
    SaveAfterWrite=Toggle(True),
    CloseAfterWrite=Toggle(True),
    ColumnStartPosition=1,
    RowStartPosition=1)  # -> UserMessages, WriteOptions
writexl = WriteToExcel(
    Run=button,
    ExcelWorksheet=int,
    ColumnNames=column_name,
    WriteOptions=wo.WriteOptions,
    ColumnnsOrRows=Toggle(False),
    DataToWriteIntoColumns=results)
